# Grasshopper definition Introduction to WallSectionWidget_case DIN4108.gh (Grasshopper 1.0.7)
# plug-ins: Heteroptera, WallSectionWidget

# ---- group: Vapour retarder
materialbuilder = MaterialBuilder(
    Name="Vapour retarder",
    Conductivity="0.22",
    VapourResistance="2.3/0.0005",
    Density="130",
    HeatCapacity="1700",
    DisplayColour=ColourSwatch(SwatchColor=RGB(0, 0, 0)))

# ---- group: Chip board
# 1. Define the property of each material involved in this wall section model
# Note that material definitions could be reused across layers
panel = Panel("Chip board / particle board")
materialbuilder_2 = MaterialBuilder(
    Name=panel,
    Conductivity="0.13",
    VapourResistance="50",
    Density="650",
    HeatCapacity="1800",
    DisplayColour=ColourSwatch(SwatchColor=RGB(216, 172, 133)))

# ---- group: Minteral wool insulation
# For releases v0.1.x:
# Heat capacity and material density do not yet come into any part of the simulation.
# If you do not wish to specify these values, please feel free to enter any value (or leave blank).
panel_2 = Panel("830")
materialbuilder_3 = MaterialBuilder(
    Name="Mineral wool",
    Conductivity="0.04",
    VapourResistance="1",
    Density="20",
    HeatCapacity=panel_2,
    DisplayColour=ColourSwatch(SwatchColor=RGB(255, 255, 150)))

# ----
# Material presets contain a minimum list of material templates.
materialpresets = MaterialPresets()  # -> Air, Concrete, Cork, Lamination, VapourControlLayer

# ----
# 2. Specify the thickness of each layer and the material usage of each layer.
# Note that the material is a Material definition obtained from step 1.
panel_3 = Panel("0.019")
layerbuilder = LayerBuilder(WSWMaterial=materialbuilder_2, Thickness=panel_3)

layerbuilder_2 = LayerBuilder(WSWMaterial=materialbuilder, Thickness="0.0005")

layerbuilder_3 = LayerBuilder(WSWMaterial=materialbuilder_2, Thickness="0.019")

layerbuilder_4 = LayerBuilder(WSWMaterial=materialbuilder_3, Thickness="0.16")

displaymaterialproperties = DisplayMaterialProperties(WSWMaterial=materialbuilder_2)  # -> Name, Conductivity, VapourResistance, Density, HeatCapacity
panel_4 = Panel(displaymaterialproperties.Density)
panel_5 = Panel(displaymaterialproperties.HeatCapacity)
panel_6 = Panel(displaymaterialproperties.Name)
panel_7 = Panel(displaymaterialproperties.Conductivity)
panel_8 = Panel(displaymaterialproperties.VapourResistance)

# ----
# Use "DisplayMaterialProperties" to disassemble a Material definition. This applies to user-defined materials as well as template materials.
displaymaterialproperties_2 = DisplayMaterialProperties(WSWMaterial=materialpresets.Concrete)  # -> Name, Conductivity, VapourResistance, Density, HeatCapacity
panel_9 = Panel(displaymaterialproperties_2.Density)
panel_10 = Panel(displaymaterialproperties_2.HeatCapacity)
panel_11 = Panel(displaymaterialproperties_2.Name)
panel_12 = Panel(displaymaterialproperties_2.Conductivity)
panel_13 = Panel(displaymaterialproperties_2.VapourResistance)

# ----
# 4. The Parameters definition is where you can specify temperature, relative humidity of interior and exterior environments.
# Contact distance, discretisation interval (step length) are optional;
# They allow for advanced control over the model.
number_slider = Slider(25, range=-10..40)
modelparameters = ModelParameters(
    InternalTemperature=number_slider,
    ExternalTemperature=Slider(10, range=-10..40),
    InternalRelativeHumidity=Slider(60, range=0..100),
    ExternalRelativeHumidity=Slider(80, range=0..100))

# ----
# 3. A list of Layer definitions comprises a Construction definition.
merge = Merge(Data1=layerbuilder, Data2=layerbuilder_2, Data3=layerbuilder_4, Data4=layerbuilder_3)
constructionbuilder = ConstructionBuilder(WSWLayers=merge)

# ----
# 5. The model takes 2 mandatory inputs:
# a Construction definition and a Parameters definition
wallsectionsolver = WallSectionSolver(WSWConstruction=constructionbuilder, WSWModelParameters=modelparameters)  # -> WSModel, Depths, Temperatures, VapourPressures, DewPoints, RelativeHumidityLevels, UValue
# U-Value of the entire wall construction
panel_14 = Panel(wallsectionsolver.UValue)

# ----
# Visualising the wall construction
wallsectiondisplay = WallSectionDisplay(WSModel=wallsectionsolver.WSModel)  # -> LayerSeparatorLines, LayerHatch

# ----
# Using the optional plane input, the location and orientation of graphs are controlled
# Height and scale factors control the sizes of the graph
number_slider_2 = Slider(0.5, range=0..1)
number_slider_3 = Slider(2, range=0..10)
# Examining relative humidity profile to identify condensation
plane = Plane(Plane(origin=(1.12465976, 0.3188300053, 0), x=(0.8162046776, -0.5777628617, 0), y=(0.5777628617, 0.8162046776, 0)))
humidityprofiledisplay = HumidityProfileDisplay(
    WSModel=wallsectionsolver.WSModel,
    LegendOnLeft=Toggle(False),
    Plane=plane,
    Height=number_slider_2,
    Scale=number_slider_3)  # -> LegendGeometry, Profile
wallsectiondisplay_2 = WallSectionDisplay(WSModel=wallsectionsolver.WSModel, Plane=plane, Height=number_slider_2, Scale=number_slider_3)  # -> LayerSeparatorLines, LayerHatch

# ----
# Use the same set of min/max values for 2 graphs ensures a valid graphical comparison
min_max = MinMax(Number=[wallsectionsolver.Temperatures, wallsectionsolver.DewPoints])  # -> Minimum, Maximum
# Comparing temperature profile and dew point temperature profile to identify condensation
# Which side is the legend plotted
boolean_toggle = BooleanToggle(False)
dewpointprofiledisplay = DewPointProfileDisplay(
    WSModel=wallsectionsolver.WSModel,
    LegendOnLeft=boolean_toggle,
    OverrideLegendMin=min_max.Minimum,
    OverrideLegendMax=min_max.Maximum)  # -> LegendGeometry, Profile
temperatureprofiledisplay = TemperatureProfileDisplay(WSModel=wallsectionsolver.WSModel, OverrideLegendMin=min_max.Minimum, OverrideLegendMax=min_max.Maximum)  # -> LegendGeometry, Profile
