# Grasshopper definition sample.gh (Grasshopper 1.0.7)
# plug-ins: WallSectionWidget

materialpresets = MaterialPresets()  # -> Air, Concrete, Cork, Lamination, VapourControlLayer
number_slider = Slider(0.1, range=0..1)
layerbuilder = LayerBuilder(WSWMaterial=materialpresets.Lamination, Thickness=number_slider)
layerbuilder_2 = LayerBuilder(WSWMaterial=materialpresets.Cork, Thickness=Slider(0.2, range=0..1))
layerbuilder_3 = LayerBuilder(WSWMaterial=materialpresets.Air, Thickness=Slider(0.1, range=0..1))
layerbuilder_4 = LayerBuilder(WSWMaterial=materialpresets.VapourControlLayer, Thickness=number_slider)
layerbuilder_5 = LayerBuilder(WSWMaterial=materialpresets.Concrete, Thickness=Slider(0.3, range=0..1))
merge = Merge(Data1=layerbuilder_3, Data2=layerbuilder_4, Data3=layerbuilder, Data5=layerbuilder_2, Data7=layerbuilder_5)
constructionbuilder = ConstructionBuilder(WSWLayers=merge)
plane = Plane(Plane(origin=(-18.47473916, -3.048787005, 0), x=(0.8904346822, 0.4551110598, 0), y=(-0.4551110598, 0.8904346822, 0)))
modelparameters = ModelParameters(
    InternalTemperature=Slider(21, range=0..100),
    ExternalTemperature=Slider(5, range=0..10),
    InternalRelativeHumidity=Slider(50, range=0..100),
    ExternalRelativeHumidity=Slider(83, range=0..100))
wallsectionsolver = WallSectionSolver(WSWConstruction=constructionbuilder, WSWModelParameters=modelparameters)  # -> WSModel, Depths, Temperatures, VapourPressures, DewPoints, RelativeHumidityLevels
wallsectiondisplay = WallSectionDisplay(WSModel=wallsectionsolver.WSModel)  # -> LayerSeparatorLines, LayerHatch
temperatureprofiledisplay = TemperatureProfileDisplay(WSModel=wallsectionsolver.WSModel, OverrideLegendMin=Slider(0, range=0..100), OverrideLegendMax=Slider(12, range=0..100))  # -> LegendGeometry, Profile
